# Grasshopper definition parametric_NC_tolerance_model_edited.gh (Grasshopper 1.0.7)
# plug-ins: treesloth01, Sasquatch

# ---- group: Individual butterfly
crv = Curve([<curve referenced from the Rhino model> x2])
crv_2 = Curve(<curve referenced from the Rhino model>)
merge = Merge(Data1=crv, Data2=crv_2)  # -> flatten(Result)
group = Group(Objects=merge)
crv_3 = Curve(<curve referenced from the Rhino model>)
merge_2 = Merge(Data1=group, Data2=crv_3)

# ---- group: Input Wiki Geometry - contours, milling pockets and slots / Contours
geo = Geometry(graft([<curve referenced from the Rhino model> x32]))

# ---- group: Input Wiki Geometry - contours, milling pockets and slots / MiIlling pockets
geo_2 = Geometry([<curve referenced from the Rhino model> x32])

# ---- group: Input Wiki Geometry - contours, milling pockets and slots / Internal slots
geo_3 = Geometry([<curve referenced from the Rhino model> x34])

# ---- group: All butterflies
milling_pockets = Curve([<curve referenced from the Rhino model> x20])
contours = Curve([<curve referenced from the Rhino model> x10])
internal_slots = Curve([<curve referenced from the Rhino model> x10])
partition = PartitionList(List=milling_pockets, Size=[2, 2])
graft = GraftTree(Tree=contours, IncludeEmptyLists=True, IncludeNullItems=True)
graft_2 = GraftTree(Tree=internal_slots, IncludeEmptyLists=True, IncludeNullItems=True)
merge_3 = Merge(Data1=partition, Data2=graft)
group_2 = Group(Objects=merge_3)
merge_4 = Merge(Data1=group_2, Data2=graft_2)

# ---- group: Input Wiki Geometry - contours, milling pockets and slots
area = Area(Geometry=geo_2)  # -> Area, Centroid
area_2 = Area(Geometry=geo_3)  # -> Area, Centroid
incurve = PointInCurve(Point=area_2.Centroid, Curve=geo)  # -> Relationship, Point
incurve_2 = PointInCurve(Point=area.Centroid, Curve=geo)  # -> Relationship, Point
bool = Boolean(incurve_2.Relationship)
bool_2 = Boolean(incurve.Relationship)
dispatch = Dispatch(List=geo_3, DispatchPattern=bool_2)  # -> ListA, ListB
dispatch_2 = Dispatch(List=geo_2, DispatchPattern=bool)  # -> ListA, ListB
geo_4 = Geometry(dispatch.ListA)
geo_5 = Geometry(dispatch_2.ListA)
merge_5 = Merge(Data1=geo, Data2=geo_5, Data3=geo_4)

# ----
project = Project(Geometry=merge_4, Plane=PlaneXY(0, 0, 0))  # -> Geometry, Transform

# ---- group: This utility helps to sort out the modified data tree after the calculation
entwine = Entwine(Branch00=geo, Branch01=geo_5, Branch02=geo_4, FlattenInputs=True)
graft_3 = GraftTree(Tree=entwine, IncludeEmptyLists=True, IncludeNullItems=True)
simplify = SimplifyTree(Tree=graft_3, Front=False)

# ----
group_3 = Group(Objects=merge_5)
geo_6 = Geometry(group_3)
project_2 = Project(Geometry=geo_6, Plane=PlaneXY(0, 0, 0))  # -> Geometry, Transform

# ---- group: Sorting geometry according to the area
bbox = BoundingBox(Content=project.Geometry, Plane=PlaneXY(0, 0, 0), UnionBox=False)  # -> Box, Box_2
trim = TrimTree(Tree=bbox.Box, Depth=1)
area_3 = Area(Geometry=trim)  # -> Area, Centroid
debox = DeconstructBox(Box=trim)  # -> Plane, X, Y, Z
sort = SortList(Keys=area_3.Area, ValuesA=trim)  # -> Keys, ValuesA
area_4 = Area(Geometry=sort.ValuesA)  # -> Area, Centroid
sort_2 = SortList(Keys=debox.Y)  # -> Keys, ValuesA
sort_3 = SortList(Keys=debox.X)  # -> Keys, ValuesA

# ---- group: Sorting according to Area
bbox_2 = BoundingBox(Content=project_2.Geometry, Plane=PlaneXY(0, 0, 0))  # -> Box, Box_2
area_5 = Area(Geometry=bbox_2.Box)  # -> Area, Centroid
debox_2 = DeconstructBox(Box=bbox_2.Box)  # -> Plane, X, Y, Z
sort_4 = SortList(Keys=area_5.Area, ValuesA=bbox_2.Box)  # -> Keys, ValuesA
area_6 = Area(Geometry=sort_4.ValuesA)  # -> Area, Centroid

# ----
# This value can be defined based on real measurements of particular environments (a storage room, workshop space) after the immediate delivery of the stock material and right before the fabrication process.
change_in_equilibrium_relative_humidity = Slider(10, range=1..100)

# ---- group: Ratio of expansion or contraction
# 0.0002 inch (0.00508 mm) per inch for each 10 percent change in equilibrium relative humidity
change_in = Panel("10")
division = Division(A=change_in_equilibrium_relative_humidity, B=change_in)
panel = Panel(division)
expansion_contraction_ratio = Panel("0.00508")
multiplication = Multiplication(A=panel, B=expansion_contraction_ratio)
panel_2 = Panel(multiplication)

# ---- group: Expansion and Contraction calculation / 1 inch = 25.4 mm
panel_3 = Panel("25.4")

# ---- group: Expansion and Contraction calculation / List of all lengths in Y direction
sort_5 = SortList(Keys=debox_2.X, ValuesA=project_2.Geometry)  # -> Keys, ValuesA

# ---- group: Expansion and Contraction calculation / Length of the component
component_length = Slider(2440, range=0..10000)

# ---- group: Expansion and Contraction calculation / List of all lengths (widths) in X direction
sort_6 = SortList(Keys=debox_2.Y, ValuesA=project_2.Geometry)  # -> Keys, ValuesA

# ---- group: 1 inch = 25.4 mm
panel_4 = Panel("25.4")

# ---- group: Swell calculation
# 0.01 inch (0.254 mm) per inch for each 10 percent change in equilibrium relative humidity
thickness_of_the_material_original_or_me = Slider(18, range=10..30)  # "Thickness of the material - original (or measured) thickness"
coefficient_of_hydroscopic_thickness_swe = Panel("0.254")  # "Coefficient of hydroscopic thickness swell"
multiplication_2 = Multiplication(A=panel, B=coefficient_of_hydroscopic_thickness_swe)
division_2 = Division(A=thickness_of_the_material_original_or_me, B="25.4")
panel_5 = Panel(multiplication_2)
panel_6 = Panel(division_2)
multiplication_3 = Multiplication(A=panel_6, B=panel_5)

# ---- group: Swell calculation / Hydroscopic Thickness Swell difference
panel_7 = Panel(multiplication_3)

# ---- group: Distribution on Both sides
# The contraction depends whether the ERH decreases
panel_8 = Panel("2")
division_3 = Division(A=panel_7, B=panel_8)

# ----
neg = Negative(Value=division_3)

# ---- group: Expanson or contraction calculation
division_4 = Division(A=sort_2.Keys, B="25.4")
division_5 = Division(A=sort_3.Keys, B="25.4")
panel_9 = Panel(division_4)
panel_10 = Panel(division_5)
multiplication_4 = Multiplication(A=panel_9, B=panel_2)
multiplication_5 = Multiplication(A=panel_10, B=panel_2)
panel_11 = Panel(multiplication_5)
panel_12 = Panel(multiplication_4)

# ---- group: Expanson or contraction calculation / Contraction has negative values
neg_2 = Negative(Value=panel_12)
neg_3 = Negative(Value=panel_11)

# ---- group: Expanson or contraction calculation (continued)
addition = Addition(A=sort_3.Keys, B=neg_3)
addition_2 = Addition(A=sort_2.Keys, B=neg_2)

# ---- group: Modification of the volume based on the calculation
rectangle = Rectangle(Plane=PlaneXY(0, 0, 0), XSize=addition, YSize=addition_2, Radius=0)  # -> Rectangle, Length
boxrec = BoxRectangle(Rectangle=rectangle.Rectangle, Height=graft("0"))
area_7 = Area(Geometry=boxrec)  # -> Area, Centroid
sort_7 = SortList(Keys=area_7.Area, ValuesA=boxrec)  # -> Keys, ValuesA
area_8 = Area(Geometry=sort_7.ValuesA)  # -> Area, Centroid
vec2pt = Vector2Pt(PointA=area_8.Centroid, PointB=area_4.Centroid, Unitize=False)  # -> Vector, Length
move = Move(Geometry=boxrec, Motion=vec2pt.Vector)  # -> Geometry, Transform

# ---- group: Modified geometry butterflies
debrep = DeconstructBrep(Brep=trim)  # -> Faces, Edges, Vertices
clean = CleanTree(RemoveNulls=True, RemoveInvalid=True, RemoveEmpty=True, Tree=debrep.Faces)
srf = Surface(clean)
trim_2 = TrimTree(Tree=srf, Depth=1)  # -> reverse(Tree)
srf_2 = Surface(move.Geometry)
srf_3 = Surface(reparameterize(srf_2))
srf_4 = Surface(reparameterize(trim_2))
area_9 = Area(Geometry=srf_4)  # -> Area, Centroid
area_10 = Area(Geometry=srf_3)  # -> Area, Centroid
srf_cp = SurfaceClosestPoint(Point=area_9.Centroid, Surface=srf_4)  # -> Point, UVPoint, Distance
srf_cp_2 = SurfaceClosestPoint(Point=area_10.Centroid, Surface=srf_3)  # -> Point, UVPoint, Distance
sporph = Sporph(G=project.Geometry, S0=srf_4, P0=srf_cp.UVPoint, S1=srf_3, P1=srf_cp_2.UVPoint, R=False)

# ----
geo_7 = Geometry(sporph)

# ---- group: Sorting the data tree structure into parts
ungroup = Ungroup(Group=geo_7)
split = SplitTree(Data=ungroup, Masks=flatten("{?;?;0}"))  # -> Positive, Negative
geo_8 = Geometry(split.Positive)
tstat = TreeStatistics(Tree=geo_8)  # -> Paths, Length, Count
item = TreeItem(Tree=geo_8, Path=tstat.Paths, Index="2", Wrap=True)
item_2 = TreeItem(Tree=geo_8, Path=tstat.Paths, Index="1", Wrap=True)
item_3 = TreeItem(Tree=geo_8, Path=tstat.Paths, Index="3", Wrap=True)
geo_9 = Geometry(item_3)
geo_10 = Geometry(item_2)

# ---- group: Sorting the data tree structure into parts / Modified milling pockets
merge_6 = Merge(Data1=geo_9, Data2=geo_10)

# ---- group: Sorting the data tree structure into parts / Modified contours
geo_11 = Geometry(item)

# ---- group: Sorting the data tree structure into parts / Modified Internal slots
geo_12 = Geometry(split.Negative)

# ---- group: Expansion and Contraction calculation
division_6 = Division(A=sort_5.Keys, B=panel_3)
division_7 = Division(A=sort_6.Keys, B=panel_4)
panel_13 = Panel(division_6)
panel_14 = Panel(division_7)
multiplication_6 = Multiplication(A=panel_14, B=panel_2)
multiplication_7 = Multiplication(A=panel_13, B=panel_2)

# ---- group: Expansion and Contraction calculation / Expansion or contraction - length / width
panel_15 = Panel(multiplication_6)

panel_16 = Panel(multiplication_7)

# ----
sort_8 = SortList(Keys=flatten(panel_15))  # -> reverse(Keys), ValuesA

# ---- group: Expansion and Contraction calculation / Contraction has negative values
neg_4 = Negative(Value=panel_16)
neg_5 = Negative(Value=panel_15)

# ----
bnd = Bounds(Numbers=sort_8.Keys)

# ---- group: Expansion and Contraction calculation (continued)
addition_3 = Addition(A=sort_6.Keys, B=neg_5)
addition_4 = Addition(A=sort_5.Keys, B=neg_4)

# ----
panel_17 = Panel(bnd)

# ---- group: Modification of the volume based on the calculation
rectangle_2 = Rectangle(Plane=PlaneXY(0, 0, 0), XSize=addition_4, YSize=addition_3, Radius=0)  # -> Rectangle, Length
boxrec_2 = BoxRectangle(Rectangle=rectangle_2.Rectangle, Height=graft("0"))
area_11 = Area(Geometry=boxrec_2)  # -> Area, Centroid
sort_9 = SortList(Keys=area_11.Area, ValuesA=boxrec_2)  # -> Keys, ValuesA
area_12 = Area(Geometry=sort_9.ValuesA)  # -> Area, Centroid
vec2pt_2 = Vector2Pt(PointA=area_12.Centroid, PointB=area_6.Centroid, Unitize=False)  # -> Vector, Length
move_2 = Move(Geometry=boxrec_2, Motion=vec2pt_2.Vector)  # -> Geometry, Transform

# ---- group: Modified geometry
debrep_2 = DeconstructBrep(Brep=bbox_2.Box)  # -> Faces, Edges, Vertices
srf_5 = Surface(reparameterize(move_2.Geometry))
clean_2 = CleanTree(RemoveNulls=True, RemoveInvalid=True, RemoveEmpty=True, Tree=debrep_2.Faces)
srf_6 = Surface(clean_2)
trim_3 = TrimTree(Tree=srf_6, Depth=1)  # -> reverse(Tree)
srf_7 = Surface(reparameterize(trim_3))
area_13 = Area(Geometry=srf_7)  # -> Area, Centroid
area_14 = Area(Geometry=srf_5)  # -> Area, Centroid
srf_cp_3 = SurfaceClosestPoint(Point=area_13.Centroid, Surface=srf_7)  # -> Point, UVPoint, Distance
srf_cp_4 = SurfaceClosestPoint(Point=area_14.Centroid, Surface=srf_5)  # -> Point, UVPoint, Distance
sporph_2 = Sporph(G=project_2.Geometry, S0=srf_7, P0=srf_cp_3.UVPoint, S1=srf_5, P1=srf_cp_4.UVPoint, R=False)

# ---- group: Sort the geometries from the data tree
ungroup_2 = Ungroup(Group=sporph_2)
add_unmatched = AddUnmatched(Data0=simplify, Data1=ungroup_2, nullPath=False)  # -> Data0, Data1
split_2 = SplitTree(Data=add_unmatched.Data0, Masks=flatten("{0;?}"))  # -> Positive, Negative
split_3 = SplitTree(Data=add_unmatched.Data0, Masks=flatten("{1;?}"))  # -> Positive, Negative
split_4 = SplitTree(Data=add_unmatched.Data0, Masks=flatten("{2;?}"))  # -> Positive, Negative

# ---- group: Stretched or shrinked Contours
geo_13 = Geometry(split_2.Positive)

# ---- group: Stretched Pockets
geo_14 = Geometry(split_3.Positive)

# ---- group: Stretched Slots according to the tolerance model
geo_15 = Geometry(split_4.Positive)

# ----
crv_4 = Curve(geo_15)
explode = Explode(Curve=crv_4, Recursive=True)  # -> Segments, Vertices
join = JoinCurves(Curves=explode.Segments, Preserve=False)

# ---- group: Modified tolerancies slots
offset = OffsetCurve(Curve=crv_4, Distance=division_3, Corners=1)

# ---- group: Swell calculation (continued)
subtraction = Subtraction(A=thickness_of_the_material_original_or_me, B=panel_7)
addition_5 = Addition(A=thickness_of_the_material_original_or_me, B=panel_7)

# ---- group: Swell calculation / Thickness / swell or shrink
# This depends whether the change in ERH increased or decreased
panel_18 = Panel(addition_5)
panel_19 = Panel(subtraction)

# ---- group: Swell calculation (continued)
Z = UnitZ(Factor=panel_18)
Z_2 = UnitZ(Factor=panel_19)

# ---- group: Modelling the components
extr = Extrude(Base=geo_11, Direction=Z)
Z_3 = UnitZ(Factor=Slider(70, range=0..100))
division_8 = Division(A=Z, B="2")
extr_2 = Extrude(Base=geo_12, Direction=Z_3)
Z_4 = UnitZ(Factor=division_8)
cap = CapHoles(Brep=extr_2)
extr_3 = Extrude(Base=merge_6, Direction=Z_4)
cap_2 = CapHoles(Brep=extr)
move_3 = Move(Geometry=extr_3, Motion=Z_4)  # -> Geometry, Transform
fastsdiff = FastSolidDifference(
    SubtractFrom=cap_2,
    SubtractWith=flatten(cap),
    Tolerance=0.001,
    computeBBFastSolidDiff=True,
    retainFastSolidDiff=True,
    strictFastSolidDiff=True,
    trueIntFastSolidDiff=False)
cap_3 = CapHoles(Brep=move_3.Geometry)

# ---- group: Modified contours According to the tolerance model
# Here it is on the decision of the designer which approach can be taken. Either extrusion of the original position of the contours or modified ones based on the tolerance model related to the humidity-driven modification of dimensions. The output geometry can be sent to the fabrication process.
extr_4 = Extrude(Base=geo_13, Direction=Z)

# ---- group: Modified contours According to the tolerance model / Real thickness according to the swell calculation
cap_4 = CapHoles(Brep=extr_4)

# ---- group: Modified butterfly components
fastsdiff_2 = FastSolidDifference(
    SubtractFrom=fastsdiff,
    SubtractWith=flatten(cap_3),
    Tolerance=0.001,
    computeBBFastSolidDiff=True,
    retainFastSolidDiff=True,
    strictFastSolidDiff=True,
    trueIntFastSolidDiff=False)

# ---- group: Modified geometry internal slots
bbox_3 = BoundingBox(Content=offset, Plane=PlaneXY(0, 0, 0))  # -> flatten(Box), Box_2
bbox_4 = BoundingBox(Content=join, Plane=PlaneXY(0, 0, 0))  # -> flatten(Box), Box_2
debrep_3 = DeconstructBrep(Brep=bbox_3.Box)  # -> Faces, Edges, Vertices
clean_3 = CleanTree(RemoveNulls=True, RemoveInvalid=True, RemoveEmpty=True, Tree=debrep_3.Faces)
item_4 = ListItem(List=clean_3, Index=0, Wrap=True)
srf_8 = Surface(flatten(item_4))
area_15 = Area(Geometry=srf_8)  # -> Area, Centroid
srf_cp_5 = SurfaceClosestPoint(Point=area_15.Centroid, Surface=srf_8)  # -> Point, UVPoint, Distance

# ----
debrep_4 = DeconstructBrep(Brep=bbox_4.Box)  # -> Faces, Edges, Vertices
clean_4 = CleanTree(RemoveNulls=True, RemoveInvalid=True, RemoveEmpty=True, Tree=debrep_4.Faces)
item_5 = ListItem(List=clean_4, Index=0, Wrap=True)

# ---- group: Modified geometry internal slots (continued)
srf_9 = Surface(flatten(item_5))
area_16 = Area(Geometry=srf_9)  # -> Area, Centroid
srf_cp_6 = SurfaceClosestPoint(Point=area_16.Centroid, Surface=srf_9)  # -> Point, UVPoint, Distance
sporph_3 = Sporph(G=flatten(join), S0=srf_9, P0=srf_cp_6.UVPoint, S1=srf_8, P1=srf_cp_5.UVPoint, R=False)

# ---- group: Modified slots according to the swell
crv_5 = Curve(sporph_3)

# ---- group: Some solide differences to model the components
Z_5 = UnitZ(Factor=Slider(70, range=0..100))
extr_5 = Extrude(Base=crv_5, Direction=Z_5)
cap_5 = CapHoles(Brep=extr_5)
division_9 = Division(A=Z, B="2")
Z_6 = UnitZ(Factor=division_9)
extr_6 = Extrude(Base=geo_14, Direction=Z_6)
move_4 = Move(Geometry=extr_6, Motion=Z_6)  # -> Geometry, Transform
fastsdiff_3 = FastSolidDifference(
    SubtractFrom=cap_4,
    SubtractWith=flatten(cap_5),
    Tolerance=0.001,
    computeBBFastSolidDiff=True,
    retainFastSolidDiff=True,
    strictFastSolidDiff=True,
    trueIntFastSolidDiff=False)
cap_6 = CapHoles(Brep=move_4.Geometry)

# ---- group: Modified components
fastsdiff_4 = FastSolidDifference(
    SubtractFrom=fastsdiff_3,
    SubtractWith=flatten(cap_6),
    Tolerance=0.001,
    computeBBFastSolidDiff=True,
    retainFastSolidDiff=True,
    strictFastSolidDiff=True,
    trueIntFastSolidDiff=False)
